vi "Main.gviweb"   [LabVIEW NXG 3.1.0]
panel controls:
  "Send Log": bool
  "Stop Test": bool
  "Start Test": bool
  "System": i32
panel indicators:
  "Files Sent": f64
  "Buffer": f64
  "Temperature": f64[][]
  "Testing": bool
  "Hostname": string
  "Connection": string
  "Memory Percentage Used": f64
  "Disk Percentage Used": f64
uses:
  NI::Skyline::Configuration::Open Configuration.gvi
  Application::Filter Systems by Package.gviweb
  Application::Get Minion ID.gviweb
  Application::Get Hostname.gviweb
  NI::Skyline::TagHTTP::Query Tags.gvi
  NI::Skyline::TagHTTP::Multi Read.gvi
  NI::Skyline::MessageHTTP::Open.gvi
  NI::Skyline::MessageHTTP::Publish.gvi
  NI::Skyline::MessageHTTP::Close.gvi
diagram:
  w1 = ""  # Server
  call "Open Configuration.gvi"(server url=w1, username="", password="") -> (configuration=w2, error out=w3)
  call "Filter Systems by Package.gviweb"(configuration in=w2, package="crio-test-cell", error in=w3) -> (configuration out=w4, systems=w5, error out=w6)
  for {
    w7 = each element of w5
    Property Node(instance in=w7) -> ("grains:data:host"=w9)
    append w9 to w8
  }
  Sort 1D Array(array=w8) -> (sorted array=w10)
  Property Node(instance in=reference to "System", "Items"=w10, "Value"=0, error in=w6) -> (error out=w11)
  while {
    Property Node(instance in=reference to "System", error in=w11) -> ("Items"=w12)
    Array Index(array=w12) -> (out0[$System]=w13)
    call "Get Minion ID.gviweb"(configuration in=w4, hostname=w13) -> (configuration out=w14, id=w15)
    event (timeout = 500) {
      on Timeout {
        call "Get Hostname.gviweb"(configuration in=w14, minionID=w15) -> (configuration out=w16, Hostname=w17, Connection=w18)
        $Hostname <- w17
        case (w18) {
          frame "Disconnected", Default {
            Property Node(instance in=reference to "Testing", "Value"=FALSE)
            w19 = TRUE
          }
          frame "Connected" {
            w20 = ["Health.Disk.UsePercentage", "Health.Memory.UsePercentage", "cRIO_Test_Cell.files_sent", "cRIO_Test_Cell.buffer", "cRIO_Test_Cell.testing"]
            for {
              w21 = each element of w20
              Concatenate Strings(w15, ".", w21) -> w23
              append w23 to w22
            }
            call "Query Tags.gvi"(paths=w22, configuration=w16) -> (tags=w24, error out=w25)
            call "Multi Read.gvi"(tags in=w24, error in=w25) -> (tag clusters=w26)
            for {
              w27 = each element of w26
              Property Node(instance in=w27) -> ("Path"=w28, "Value"=w29)
              Search Or Split String(search string/char=".", string=w28) -> (match + rest of string=w30)
              case (w30) {
                frame ".Health.Disk.UsePercentage" {
                  Scan Value(format string="%f", string=w29) -> (value=w31)
                  $"Disk Percentage Used" <- w31
                }
                frame ".Health.Memory.UsePercentage" {
                  Scan Value(format string="%f", string=w29) -> (value=w32)
                  $"Memory Percentage Used" <- w32
                }
                frame ".cRIO_Test_Cell.files_sent" {
                  Scan Value(format string="%d", string=w29) -> (value=w33)
                  $"Files Sent" <- w33
                }
                frame ".cRIO_Test_Cell.buffer" {
                  Scan Value(format string="%d", string=w29) -> (value=w34)
                  $Buffer <- w34
                }
                frame ".cRIO_Test_Cell.testing" {
                  case (w29) {
                    frame "False", Default {
                      w35 = FALSE
                    }
                    frame "True" {
                      w35 = TRUE
                    }
                  }
                  $Testing <- w35
                }
                frame Default { }
              }
            }
            Concatenate Strings(w15, ".", "cRIO_Test_Cell.mod*") -> w36
            Build Array(w36) -> w37
            call "Query Tags.gvi"(paths=w37, configuration=w16) -> (tags=w38, error out=w39)
            call "Multi Read.gvi"(tags in=w38, error in=w39) -> (tag clusters=w40)
            for {
              w41 = each element of w40
              Property Node(instance in=w41) -> ("Value"=w43)
              Scan Value(format string="%f", string=w43) -> (value=w44)
              Build Array(w44) -> w45
              append w45 to w42
            }
            Transpose 2D Array(2D array=w42) -> (transposed array=w46)
            $Temperature <- w46
            w19 = FALSE
          }
        }
        Property Node(instance in=reference to "Stop Test", "Disabled"=w19)
        $Connection <- w18
        Property Node(instance in=reference to "Start Test", "Disabled"=w19)
        Property Node(instance in=reference to "Send Log", "Disabled"=w19)
      }
      on "Send Log" Value changed {
        call "Open.gvi"(configuration=w14) -> (message session out=w47, error out=w48)
        call "Publish.gvi"(message session=w47, topic=w15, message="Send File", error in=w48) -> (message session out=w49, error out=w50)
        call "Close.gvi"(message session=w49, error in=w50)
      }
      on "Start Test" Value changed {
        call "Open.gvi"(configuration=w14) -> (message session out=w51, error out=w52)
        call "Publish.gvi"(message session=w51, topic=w15, message="Start Test", error in=w52) -> (message session out=w53, error out=w54)
        call "Close.gvi"(message session=w53, error in=w54)
      }
      on "Stop Test" Value changed {
        call "Open.gvi"(configuration=w14) -> (message session out=w55, error out=w56)
        call "Publish.gvi"(message session=w55, topic=w15, message="Stop Test", error in=w56) -> (message session out=w57, error out=w58)
        call "Close.gvi"(message session=w57, error in=w58)
      }
    }
    stop if FALSE
  }
